# Grasshopper definition WatchdogExamples.gh (Grasshopper 1.0.8)
# plug-ins: Watchdog

# ---- group: Cross-Reference Solve Timeout
series = Series(Start=0, Step=1, Count=20)  # disabled
series_2 = Series(Start=0, Step=4, Count=1000)  # disabled
construct_point = ConstructPoint(XCoordinate=series, YCoordinate=graft(series_2), ZCoordinate=0)  # disabled
construct_point_2 = ConstructPoint(XCoordinate=graft(series), YCoordinate=series_2, ZCoordinate=0)  # disabled
line = Line(StartPoint=flatten(construct_point_2), EndPoint=construct_point)  # disabled
line_2 = Line(StartPoint=flatten(construct_point_2), EndPoint=construct_point)  # disabled

# ---- group: Upstream Propagation Timeout
surface = Surface(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)  # disabled
curve = Curve([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])  # disabled
surface_split = SurfaceSplit(Surface=surface, Curves=curve)  # disabled
brep_edges = BrepEdges(Brep=surface_split)  # -> flatten(Naked), Interior, NonManifold; disabled
curve_middle = CurveMiddle(Curve=brep_edges.Naked)  # disabled
cull_pattern = CullPattern(List=curve_middle, CullPattern=invert([False, False, True, True]))  # disabled
cull_pattern_2 = CullPattern(List=curve_middle, CullPattern=[False, False, True, True])  # disabled
line_3 = Line(StartPoint=graft(cull_pattern_2), EndPoint=cull_pattern)  # disabled

# ---- group: Cross-Reference Solve Timeout
populate_2d = Populate2D(
    Region={Plane=PlaneXY(26.57318561, -28.95631902, 0), Size=Domain2(u=-841.0417653..841.0417653, v=-727.0987787..727.0987787)},
    Count=5000,
    Seed=1)  # disabled
distance = Distance(PointA=populate_2d, PointB=graft(populate_2d))  # disabled

# ----
watchdog = Watchdog(Active=Toggle(False), MaxSec=Slider(3, range=0..100))

# ---- group: 50Second!!!!
point = Point([Point(38.47961174, 424.9683321, 0), Point(43.47961174, 424.9683321, 0), Point(48.47961174, 424.9683321, 0), Point(53.47961174, 424.9683321, 0), Point(58.47961174, 424.9683321, 0), Point(63.47961174, 424.9683321, 0)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])  # disabled
closest_points = ClosestPoints(Point=graft(point), Cloud=point, Count=3)  # -> ClosestPoint, CPIndex, Distance; disabled

# ---- group: Chained Solve Timeout
populate_2d_2 = Populate2D(
    Region={Plane=PlaneXY(26.57318561, -28.95631902, 0), Size=Domain2(u=-841.0417653..841.0417653, v=-727.0987787..727.0987787)},
    Count=5000,
    Seed=1)  # disabled
unit_z = UnitZ(Factor=40)  # disabled
rectangle = Rectangle(Plane=populate_2d_2, XSize=Domain(-50, 50), YSize=Domain(-50, 50), Radius=0)  # -> Rectangle, Length; disabled
extrude = Extrude(Base=rectangle.Rectangle, Direction=unit_z)  # disabled
series_3 = Series(Start=0, Step=50, Count=10)  # disabled
cap_holes = CapHoles(Brep=extrude)  # disabled
unit_z_2 = UnitZ(Factor=series_3)  # disabled
move = Move(Geometry=cap_holes, Motion=graft(unit_z_2))  # -> flatten(Geometry), Transform; disabled
brep_edges_2 = BrepEdges(Brep=move.Geometry)  # -> Naked, flatten(Interior), NonManifold; disabled

# ----
number_slider = Slider(5, range=0..10)  # disabled
point_2 = Point([Point(428.4796117, 791.9858517, 45), Point(423.4796117, 791.9858517, 45), Point(418.4796117, 791.9858517, 45), Point(413.4796117, 791.9858517, 45), Point(408.4796117, 791.9858517, 45), Point(403.4796117, 791.9858517, 45)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])  # disabled
center_box = CenterBox(Base=point_2, X=number_slider, Y=number_slider, Z=number_slider)  # disabled
number_slider_2 = Slider(200, range=0..1000)  # disabled
brep_edges_3 = BrepEdges(Brep=center_box)  # -> Naked, Interior, NonManifold; disabled
divide_curve = DivideCurve(Curve=brep_edges_3.Interior, Count=number_slider_2, Kinks=False)  # -> Points, Tangents, Parameters; disabled
divide_curve_2 = DivideCurve(Curve=brep_edges_3.Interior, Count=number_slider_2, Kinks=False)  # -> Points, Tangents, Parameters; disabled
param_viewer = ParamViewer(divide_curve.Points)  # disabled
param_viewer_2 = ParamViewer(divide_curve_2.Points)  # disabled
